# Grasshopper definition RayTracing_01.gh (Grasshopper 0.9.76)
# plug-ins: Python Interpreter

number_slider = Slider(12, range=0..100)
geo = Geometry(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)
pt = ConstructPoint(XCoordinate=number_slider, YCoordinate=number_slider, ZCoordinate=number_slider)
python = PythonScript(G=geo, n=Slider(1, range=1..1000), SP=pt, R=Slider(500, range=1..500))  # -> Rays, ReflectPoints; inputs G: Brep, n: Int32, SP: Point3d, R: Int32
# ---------- python: Python ----------
import random
import math
import rhinoscriptsyntax as rs
import Rhino as rc
    
Geo=rc.Geometry.Brep.Duplicate(G)
Origo=rs.AddPoint(0,0,0)
    
#Testing wether source point is contained within Geometry
CS = Geo.IsPointInside(SP,0.01,True)

#Number of Surfaces in Geometry
F = Geo.Surfaces.Count

#Extracting Surfaces from Geometry
Surfaces = []
def Surf(f):
    surface = rs.ExtractSurface(G,f,copy=True)
    return surface[0]
print range (int(F))
for f in range (F):
    Surfaces.append(Surf(f))

#Extracting Surface Points from Geometry Surfaces
SurfPoints = []
def SurfacePoints(f):
    point = rs.SurfaceAreaCentroid(Surfaces[f])
    return point[0]
print range (int(F))
for f in range (F):
    SurfPoints.append(SurfacePoints(f))

#Surface Normal Vectors
Param = []
def UV_Param(f):
    point = rs.SurfaceClosestPoint(Surfaces[f],SurfPoints[f])
    return point[0]
print range (int(F))
for f in range (F):
    Param.append(UV_Param(f))
    
SurfNormal = []
def SurfaceNormal(f):
    vector = rs.VectorReverse(rs.SurfaceNormal(Surfaces[f],Param))
    return vector
for f in range (F):
    SurfNormal.append(SurfaceNormal(f))
    
    
#Ray Vector Points
def RayPoints(theta,phi):
    point = rs.AddPoint(math.sin(theta)*math.cos(phi),math.sin(theta)*math.sin(phi),math.cos(theta))
    return point
#Ray Vectors between Ray Vector Points and Origo
def RayVectors(RayPoints,OrigoPoints):
    Vector = rs.VectorCreate(RayPoints,Origo)
    return Vector
    
#RayVectors
RayVec = []
print range(int(n))
for i in range (n):
    theta = random.uniform(0,(2*math.pi))  
    phi = random.uniform(0,(2*math.pi))
    RayVec.append(RayVectors(RayPoints(theta,phi),Origo))

ReflectionPoints = [SP]
RefVec = [RayVec[0]]
Distances = []
MinDistances = []
Rays = []
RayData = []
RayData.append(SP)
RayData.append(RayVec[0])

r = R
while r > 0:
    #Vector From Source to Geometry Surfaces
    LenVec = []
    def LengthVectors(f):
        vector = rs.VectorCreate(SurfPoints[f],RayData[0])
        return vector
    for f in range (F):
        LenVec.append(LengthVectors(f))
    
    Dist = []
    #Distance from Source Point to Geometry Surfaces
    def Distance(f):
        length = (rs.VectorDotProduct(SurfNormal[f],LenVec[f]))/(rs.VectorDotProduct(RayData[1],SurfNormal[f]))
        return length
    for f in range (F):
        Dist.append(Distance(f))
    
        Distances.append(Distance(f))
    
    #Minimum distance
    DistMin = min(n for n in Dist if n > 1*10**-12)
    index = [i for i,x in enumerate(Dist) if x == DistMin]
    
    MinDistances.append(DistMin)
    MinDistances.append(index[0])
    #Reflection Point
    ReflectionPoint = RayData[0]+RayData[1]*DistMin
    
    ReflectionPoints.append(ReflectionPoint)
    ReflectPoints=ReflectionPoints[:-1]
    
    Rays.append(rs.VectorCreate(ReflectionPoint,RayData[0]))
    
    #Reflected Vector
    ReflectionVec = rs.VectorSubtract(RayData[1],(2*SurfNormal[index[0]]*rs.VectorDotProduct(SurfNormal[index[0]],RayData[1])))
    NormVec=rs.VectorCrossProduct(RayData[1],ReflectionVec)
    #if  rs.VectorAngle(SurfNormal[index[0]],ReflectionVec) > 90:
        #ReflectionVec=rs.VectorRotate(ReflectionVec,180-2*rs.VectorAngle(SurfNormal[index[0]],ReflectionVec),NormVec)
    
    print ReflectionVec
    RefVec.append(ReflectionVec)
    RefVector = RefVec[:-1]
    
    RayData=(ReflectionPoint,ReflectionVec)
    
    r = r-1
# ---------- end python ----------
vdis = VectorDisplay(Anchor=python.ReflectPoints, Vector=python.Rays)
